# Grasshopper definition r.gh (Grasshopper 1.0.8)
# plug-ins: Pufferfish

crv = Curve([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])
number_slider = Slider(5, range=0..10)
boundary = BoundarySurfaces(Edges=crv)
Z = UnitZ(Factor=Slider(4, range=0..10))
pt = ConstructPoint(XCoordinate=Slider(0, range=0..100), YCoordinate=Slider(52, range=0..100), ZCoordinate=0)
cir = Circle(Plane=pt, Radius=Slider(4, range=0..10))
cir_2 = Circle(Plane=pt, Radius=Slider(2, range=0..10))
scale_nu = ScaleNU(Geometry=boundary, Plane=PlaneXY(0, 0, 0), ScaleX=number_slider, ScaleY=number_slider, ScaleZ=1)  # -> Geometry, Transform
brec = BoundingRectangle(Geometry=scale_nu.Geometry, Plane=PlaneXY(0, 0, 0), Axis=0, Slide=0, Union=True)  # -> Bounding, DimensionX, DimensionY
rdiff = RegionDifference(CurvesA=cir, CurvesB=cir_2)
boundary_2 = BoundarySurfaces(Edges=rdiff)
panel = Panel(brec.Bounding)
extr = Extrude(Base=scale_nu.Geometry, Direction=Z)
extr_2 = Extrude(Base=boundary_2, Direction=Z)
sunion = SolidUnion(Breps=flatten([extr, extr_2]))
brep = Brep(sunion)
