# Grasshopper definition tet.gh (Grasshopper 1.0.8)
# plug-ins: Pufferfish, ClipperComponents

一列の奥行 = Slider(30, range=0..100)
一列の高さ = Slider(13, range=0..30)
一列の幅 = Slider(10, range=0..30)
number_slider = Slider(4, range=0..10)
溝の幅 = Slider(7, range=0..20)
溝の奥行 = Slider(100, range=0..100)
溝の高さ = Slider(8, range=0..20)
穴あけの幅 = Slider(5, range=0..10)
高さ方向のオフセット = Slider(2, range=0..10)
number_slider_2 = Slider(100, range=0..100)
ミノの頭の高さ位置 = Slider(0.4, range=0..2)
ミノ高さ１ = Slider(6, range=0..10)
ミノ高さ２ = Slider(2, range=0..10)
クリアランス = Slider(0.4, range=0..1)
number_slider_3 = Slider(0.85, range=0.8..1)
ミノ同士の間隔_周りをどれぐらい削るか = Slider(0.2, range=0..1)
number_slider_4 = Slider(3, range=0..10)
num = Number(一列の幅)
multiplication = Multiplication(A=一列の幅, B=2)
multiplication_2 = Multiplication(A=num, B=2)
subtraction = Subtraction(A=溝の幅, B=クリアランス)
subtraction_2 = Subtraction(A=溝の幅, B=クリアランス)
multiplication_3 = Multiplication(A=一列の幅, B=2)
subtraction_3 = Subtraction(A=穴あけの幅, B=クリアランス)
subtraction_4 = Subtraction(A=穴あけの幅, B=クリアランス)
neg = Negative(Value=一列の幅)
neg_2 = Negative(Value=一列の奥行)
neg_3 = Negative(Value=溝の幅)
neg_4 = Negative(Value=穴あけの幅)
neg_5 = Negative(Value=溝の奥行)
neg_6 = Negative(Value=number_slider_2)
addition = Addition(A=一列の高さ, B=ミノの頭の高さ位置)
neg_7 = Negative(Value=subtraction_2)
recgrid = Rectangular(Plane=PlaneXY(0, 0, 0), SizeX=multiplication_2, SizeY=multiplication_2, ExtentX=number_slider_4, ExtentY=number_slider_4)  # -> Cells, Points
neg_8 = Negative(Value=subtraction)
series = Series(Start=0, Step=multiplication_3, Count=number_slider)
neg_9 = Negative(Value=subtraction_3)
neg_10 = Negative(Value=subtraction_4)
dom = ConstructDomain(DomainStart=neg, DomainEnd=一列の幅)
dom_2 = ConstructDomain(DomainStart=neg_2, DomainEnd=一列の奥行)
dom_3 = ConstructDomain(DomainStart=neg_3, DomainEnd=溝の幅)
dom_4 = ConstructDomain(DomainStart=neg_5, DomainEnd=溝の奥行)
dom_5 = ConstructDomain(DomainStart=neg_4, DomainEnd=穴あけの幅)
dom_6 = ConstructDomain(DomainStart=neg_6, DomainEnd=number_slider_2)
dom_7 = ConstructDomain(DomainStart=neg_8, DomainEnd=subtraction)
dom_8 = ConstructDomain(DomainStart=neg_7, DomainEnd=subtraction_2)
X = UnitX(Factor=series)
dom_9 = ConstructDomain(DomainStart=neg_10, DomainEnd=subtraction_4)
dom_10 = ConstructDomain(DomainStart=neg_9, DomainEnd=subtraction_3)
multiplication_4 = Multiplication(A=multiplication, B=number_slider)
neg_11 = Negative(Value=一列の幅)
flatten = FlattenTree(Tree=recgrid.Points, Path="{0}")
addition_2 = Addition(A=一列の奥行, B=Slider(8, range=0..10))
rectangle = Rectangle(Plane=PlaneXY(0, 0, 0), XSize=dom_5, YSize=dom_6, Radius=0)  # -> Rectangle, Length
rectangle_2 = Rectangle(Plane=PlaneXY(0, 0, 0), XSize=dom_3, YSize=dom_2, Radius=0)  # -> Rectangle, Length
rectangle_3 = Rectangle(Plane=PlaneXY(0, 0, 0), XSize=dom_7, YSize=dom_8, Radius=0)  # -> Rectangle, Length
rectangle_4 = Rectangle(Plane=PlaneXY(0, 0, 0), XSize=dom, YSize=dom_2, Radius=0)  # -> Rectangle, Length
addition_3 = Addition(A=neg_11, B=multiplication_4)
dom_11 = ConstructDomain(DomainStart=neg_11, DomainEnd=addition_3)
dom_12 = ConstructDomain(DomainStart=0, DomainEnd=溝の高さ)
dom_13 = ConstructDomain(DomainStart=一列の奥行, DomainEnd=addition_2)
panel = Panel("""0
4
8
12""")
panel_2 = Panel("""0
1
4
5""")
panel_3 = Panel("""0
4
8
9""")
panel_4 = Panel("""0
1
4
8""")
panel_5 = Panel("""0
4
5
8""")
panel_6 = Panel("""0
4
5
9""")
panel_7 = Panel("""1
4
5
8""")
rectangle_5 = Rectangle(Plane=PlaneXY(0, 0, 0), XSize=dom_9, YSize=dom_10, Radius=0)  # -> Rectangle, Length
subtraction_5 = Subtraction(A=溝の高さ, B=クリアランス)
dom_14 = ConstructDomain(DomainStart=0, DomainEnd=Slider(30, range=0..30))
num_2 = Number(一列の幅)
rectangle_6 = Rectangle(Plane=PlaneXY(0, 0, 0), XSize=dom_11, YSize=dom_13, Radius=0)  # -> Rectangle, Length
dom_15 = ConstructDomain(DomainStart=0, DomainEnd=一列の高さ)
subtraction_6 = Subtraction(A=num_2, B=ミノ同士の間隔_周りをどれぐらい削るか)
dom_16 = ConstructDomain(DomainStart=クリアランス, DomainEnd=subtraction_5)
number_slider_5 = Slider(3, range=0..10)
boxrec = BoxRectangle(Rectangle=rectangle.Rectangle, Height=dom_14)
boxrec_2 = BoxRectangle(Rectangle=rectangle_2.Rectangle, Height=dom_12)
item = ListItem(List=flatten, Index=panel, Wrap=True)
list = ValueList({"0", "1", "2", "3", "4", "5", "6", "7"}, selected="6")
item_2 = ListItem(List=flatten, Index=panel_3, Wrap=True)
item_3 = ListItem(List=flatten, Index=panel_2, Wrap=True)
item_4 = ListItem(List=flatten, Index=panel_4, Wrap=True)
boxrec_3 = BoxRectangle(Rectangle=rectangle_4.Rectangle, Height=dom_15)
dom_17 = ConstructDomain(DomainStart=クリアランス, DomainEnd=addition)
item_5 = ListItem(List=flatten, Index=panel_5, Wrap=True)
item_6 = ListItem(List=flatten, Index=panel_6, Wrap=True)
item_7 = ListItem(List=flatten, Index=panel_7, Wrap=True)
neg_12 = Negative(Value=subtraction_6)
boxrec_4 = BoxRectangle(Rectangle=rectangle_3.Rectangle, Height=dom_16)
addition_4 = Addition(A=一列の高さ, B=ミノ高さ１)
series_2 = Series(Start=0, Step=1, Count=Slider(12, range=0..20))
dom_18 = ConstructDomain(DomainStart=neg_12, DomainEnd=subtraction_6)
panel_8 = Panel("""8
9
10
11""")
Z = UnitZ(Factor=addition_4)
crv = Curve(rectangle_6.Rectangle)
Z_2 = UnitZ(Factor=高さ方向のオフセット)
division = Division(A=一列の高さ, B=2)
boxrec_5 = BoxRectangle(Rectangle=rectangle_5.Rectangle, Height=dom_17)
panel_9 = Panel("""1
3
5
7""")
rectangle_7 = Rectangle(Plane=PlaneXY(0, 0, 0), XSize=dom_18, YSize=dom_18, Radius=0)  # -> Rectangle, Length
addition_5 = Addition(A=高さ方向のオフセット, B=division)
rectangle_8 = Rectangle(Plane=PlaneXY(0, 0, 0), XSize=dom, YSize=dom, Radius=0)  # -> Rectangle, Length
boundary = BoundarySurfaces(Edges=crv)
filter = StreamFilter(Gate=list, Stream0=item, Stream1=item_3, Stream2=item_2, Stream3=item_4, Stream4=item_5, Stream5=item_6, Stream6=item_7)
Z_3 = UnitZ(Factor=addition_5)
scale_nu = ScaleNU(Geometry=rectangle_7.Rectangle, Plane=PlaneXY(0, 0, 0), ScaleX=number_slider_3, ScaleY=number_slider_3, ScaleZ=1)  # -> Geometry, Transform
Z_4 = UnitZ(Factor=ミノの頭の高さ位置)
extr = Extrude(Base=boundary, Direction=Z)
filedge = FilletEdge(Shape=boxrec_5, Blend=0, Metric=1, Edges=panel_8, Radii=number_slider_5)
filedge_2 = FilletEdge(Shape=boxrec_4, Blend=0, Metric=1, Edges=series_2, Radii=number_slider_5)
filedge_3 = FilletEdge(Shape=boxrec_2, Blend=0, Metric=1, Edges=panel_9, Radii=Slider(3, range=0..10))
Z_5 = UnitZ(Factor=ミノ高さ２)
Z_6 = UnitZ(Factor=ミノ高さ１)
addition_6 = Addition(A=Z_2, B=Z_4)
Z_7 = UnitZ(Factor=addition)
move = Move(Geometry=filedge_2, Motion=Z_2)  # -> Geometry, Transform
move_2 = Move(Geometry=boxrec, Motion=Z_3)  # -> Geometry, Transform
move_3 = Move(Geometry=filedge_3, Motion=Z_2)  # -> Geometry, Transform
move_4 = Move(Geometry=filedge, Motion=Z_2)  # -> Geometry, Transform
brep = Brep(boxrec_3)
addition_7 = Addition(A=Z_2, B=Z_7, C=Z_6, D=Z_5)
move_5 = Move(Geometry=rectangle_7.Rectangle, Motion=Z_7)  # -> Geometry, Transform
move_6 = Move(Geometry=scale_nu.Geometry, Motion=addition_7)  # -> Geometry, Transform
sunion = SolidUnion(Breps=[move_3.Geometry, move_2.Geometry])
move_7 = Move(Geometry=move_5.Geometry, Motion=Z_6)  # -> Geometry, Transform
boolean_difference_hispeed = BooleanDifferenceHiSpeed(x=brep, y=sunion)
brep_2 = Brep(boolean_difference_hispeed)
brep_3 = Brep(move_4.Geometry)
boundary_2 = BoundarySurfaces(Edges=move_5.Geometry)
loft = Loft(
    Curves=[move_5.Geometry, move_7.Geometry],
    Options={Adjust=False, Closed=False, LoftEnds=0, LoftSimp=0, LoftType=0, Rebuild=10, Refit=0.01})
brep_4 = Brep(move.Geometry)
loft_2 = Loft(
    Curves=[move_7.Geometry, move_6.Geometry],
    Options={Adjust=False, Closed=False, LoftEnds=0, LoftSimp=0, LoftType=0, Rebuild=10, Refit=0.01})
move_8 = Move(Geometry=rectangle_8.Rectangle, Motion=Z_7)  # -> Geometry, Transform
join = BrepJoin(Breps=[loft, loft_2])  # -> Breps, Closed
move_9 = Move(Geometry=brep_2, Motion=X)  # -> Geometry, Transform
cap = CapHoles(Brep=join.Breps)
brep_5 = Brep(cap)
merge = Merge(Data1=brep_4, Data2=brep_3, Data3=brep_5)
sunion_2 = SolidUnion(Breps=flatten([move_9.Geometry, extr]))
pt = ConstructPoint(XCoordinate=0, YCoordinate=0, ZCoordinate=0)
move2pt = MoveToPoint(Geometry=move_8.Geometry, PointA=pt, PointB=filter)  # -> Moved, Vector, Transform
runion = RegionUnion(Curves=move2pt.Moved)
sunion_3 = SolidUnion(Breps=flatten(merge))
polyoffset = PolylineOffset(
    Polylines=runion,
    Distance=ミノ同士の間隔_周りをどれぐらい削るか,
    Plane=Plane(origin=(0, 0, 0), x=(0, 0, 0), y=(0, 0, 0)),
    Tolerance=0.001,
    ClosedFillet=2,
    OpenFillet=2,
    Miter=2)  # -> Contour, Holes
crv_2 = Curve(polyoffset.Holes)
boundary_3 = BoundarySurfaces(Edges=crv_2)
move2pt_2 = MoveToPoint(Geometry=sunion_3, PointA=pt, PointB=filter)  # -> Moved, Vector, Transform
extr_2 = Extrude(Base=boundary_3, Direction=Z_6)
sunion_4 = SolidUnion(Breps=flatten([move2pt_2.Moved, extr_2]))
preview = CustomPreview(
    Geometry=sunion_4,
    Material={diffuse=RGB(221, 160, 221), emission=RGB(66, 48, 66), shine=0.5, specular=RGB(255, 255, 255), transparency=0})
preview_2 = CustomPreview(Geometry=sunion_2, Material=ColourSwatch(SwatchColor=RGB(130, 255, 255)))

# ==== cluster BooleanDifferenceHiSpeed
x = ClusterInput()
y = ClusterInput()
boolean_difference = GhPythonScript(x=x, y=flatten(y))  # -> out, a; inputs y: list
# ---------- boolean_difference: Python ----------
import rhinoscriptsyntax as rs
a=rs.BooleanDifference(x,y)
# ---------- end boolean_difference ----------
output = ClusterOutput(boolean_difference.a)
