# Grasshopper definition tet_ver2_for_WISSdemo_smaller.gh (Grasshopper 1.0.8)
# plug-ins: Pufferfish, ClipperComponents

number_slider = Slider(3, range=0..10)
number_slider_2 = Slider(14, range=0..20)
一列の奥行 = Slider(240, range=0..240)
一列の奥行_2 = Slider(30, range=0..240)
number_slider_3 = Slider(50, range=0..100)
number_slider_4 = Slider(10, range=0..10)
一列の高さ = Slider(10, range=0..30)
溝の幅 = Slider(6, range=0..20)
一列の幅 = Slider(15, range=0..30)
multiplication = Multiplication(A=一列の幅, B=number_slider_2)
number_slider_5 = Slider(0.2, range=0..1)
溝の高さ = Slider(6, range=0..20)
穴あけの幅 = Slider(4.5, range=0..10)
高さ方向のオフセット = Slider(2, range=0..10)
ミノの頭の高さ位置 = Slider(0.4, range=0..2)
ミノ高さ２ = Slider(1, range=0..10)
クリアランス = Slider(0.4, range=0..1)
number_slider_6 = Slider(0.85, range=0.8..1)
ミノ高さ１ = Slider(2, range=0..10)
ミノ同士の間隔_周りをどれぐらい削るか = Slider(0.2, range=0..1)
pt = ConstructPoint(XCoordinate=0, YCoordinate=0, ZCoordinate=0)
pt_2 = ConstructPoint(XCoordinate=number_slider_3, YCoordinate=0, ZCoordinate=0)
division = Division(A=一列の奥行_2, B=2)
division_2 = Division(A=一列の幅, B=2)
number_slider_7 = Slider(3, range=0..10)
number_slider_8 = Slider(3, range=0..10)
num = Number(division_2)
division_3 = Division(A=number_slider_3, B=2)
multiplication_2 = Multiplication(A=division_2, B=2)
multiplication_3 = Multiplication(A=division_2, B=2)
multiplication_4 = Multiplication(A=num, B=2)
subtraction = Subtraction(A=溝の幅, B=number_slider_5)
subtraction_2 = Subtraction(A=溝の幅, B=クリアランス)
subtraction_3 = Subtraction(A=溝の幅, B=クリアランス)
subtraction_4 = Subtraction(A=穴あけの幅, B=number_slider_5)
subtraction_5 = Subtraction(A=溝の高さ, B=number_slider_5)
subtraction_6 = Subtraction(A=穴あけの幅, B=クリアランス)
subtraction_7 = Subtraction(A=穴あけの幅, B=クリアランス)
neg = Negative(Value=division_2)
neg_2 = Negative(Value=division)
neg_3 = Negative(Value=multiplication_3)
neg_4 = Negative(Value=subtraction)
neg_5 = Negative(Value=division)
addition = Addition(A=一列の高さ, B=ミノの頭の高さ位置)
neg_6 = Negative(Value=subtraction_3)
recgrid = Rectangular(Plane=PlaneXY(0, 0, 0), SizeX=multiplication_4, SizeY=multiplication_4, ExtentX=number_slider_8, ExtentY=number_slider_8)  # -> Cells, Points
neg_7 = Negative(Value=subtraction_2)
neg_8 = Negative(Value=subtraction_4)
neg_9 = Negative(Value=subtraction_6)
neg_10 = Negative(Value=subtraction_7)
neg_11 = Negative(Value=division)
series = Series(Start=neg_3, Step=multiplication_3, Count=16)
series_2 = Series(Start=0, Step=multiplication_3, Count=number_slider_2)
dom = ConstructDomain(DomainStart=neg, DomainEnd=division_2)
dom_2 = ConstructDomain(DomainStart=neg_2, DomainEnd=division)
dom_3 = ConstructDomain(DomainStart=neg_4, DomainEnd=subtraction)
dom_4 = ConstructDomain(DomainStart=neg_5, DomainEnd=division)
dom_5 = ConstructDomain(DomainStart=neg_7, DomainEnd=subtraction_2)
dom_6 = ConstructDomain(DomainStart=neg_6, DomainEnd=subtraction_3)
multiplication_5 = Multiplication(A=multiplication_2, B=number_slider_2)
dom_7 = ConstructDomain(DomainStart=neg_8, DomainEnd=subtraction_4)
dom_8 = ConstructDomain(DomainStart=neg_10, DomainEnd=subtraction_7)
dom_9 = ConstructDomain(DomainStart=neg_9, DomainEnd=subtraction_6)
dom_10 = ConstructDomain(DomainStart=neg_11, DomainEnd=division)
X = UnitX(Factor=series_2)
X_2 = UnitX(Factor=series)
flatten = FlattenTree(Tree=recgrid.Points, Path="{0}")
neg_12 = Negative(Value=division_2)
addition_2 = Addition(A=division, B=number_slider_4)
rectangle = Rectangle(Plane=PlaneXY(0, 0, 0), XSize=dom_5, YSize=dom_6, Radius=0)  # -> Rectangle, Length
rectangle_2 = Rectangle(Plane=PlaneXY(0, 0, 0), XSize=dom, YSize=dom_2, Radius=0)  # -> Rectangle, Length
Z = UnitZ(Factor=number_slider_7)
addition_3 = Addition(A=number_slider_7, B=number_slider_4)
addition_4 = Addition(A=neg_12, B=multiplication_5)
Z_2 = UnitZ(Factor=addition_3)
rectangle_3 = Rectangle(Plane=PlaneXY(0, 0, 0), XSize=dom_3, YSize=dom_2, Radius=0)  # -> Rectangle, Length
rectangle_4 = Rectangle(Plane=PlaneXY(0, 0, 0), XSize=dom_7, YSize=dom_10, Radius=0)  # -> Rectangle, Length
dom_11 = ConstructDomain(DomainStart=0, DomainEnd=subtraction_5)
dom_12 = ConstructDomain(DomainStart=division, DomainEnd=addition_2)
dom_13 = ConstructDomain(DomainStart=neg_12, DomainEnd=addition_4)
panel = Panel("""0
4
8
12""")
panel_2 = Panel("""0
1
4
5""")
panel_3 = Panel("""0
4
8
9""")
panel_4 = Panel("""0
1
4
8""")
panel_5 = Panel("""0
4
5
8""")
panel_6 = Panel("""0
4
5
9""")
panel_7 = Panel("""1
4
5
8""")
rectangle_5 = Rectangle(Plane=PlaneXY(0, 0, 0), XSize=dom_8, YSize=dom_9, Radius=0)  # -> Rectangle, Length
subtraction_8 = Subtraction(A=溝の高さ, B=クリアランス)
dom_14 = ConstructDomain(DomainStart=0, DomainEnd=Slider(30, range=0..30))
num_2 = Number(division_2)
dom_15 = ConstructDomain(DomainStart=0, DomainEnd=一列の高さ)
rectangle_6 = Rectangle(Plane=PlaneXY(0, 0, 0), XSize=dom_13, YSize=dom_12, Radius=0)  # -> Rectangle, Length
subtraction_9 = Subtraction(A=num_2, B=ミノ同士の間隔_周りをどれぐらい削るか)
dom_16 = ConstructDomain(DomainStart=クリアランス, DomainEnd=subtraction_8)
number_slider_9 = Slider(2.5, range=0..10)
boxrec = BoxRectangle(Rectangle=rectangle_4.Rectangle, Height=dom_14)
boxrec_2 = BoxRectangle(Rectangle=rectangle_3.Rectangle, Height=dom_11)
item = ListItem(List=flatten, Index=panel, Wrap=True)
item_2 = ListItem(List=flatten, Index=panel_3, Wrap=True)
item_3 = ListItem(List=flatten, Index=panel_2, Wrap=True)
item_4 = ListItem(List=flatten, Index=panel_4, Wrap=True)
boxrec_3 = BoxRectangle(Rectangle=rectangle_2.Rectangle, Height=dom_15)
dom_17 = ConstructDomain(DomainStart=クリアランス, DomainEnd=addition)
item_5 = ListItem(List=flatten, Index=panel_5, Wrap=True)
item_6 = ListItem(List=flatten, Index=panel_6, Wrap=True)
item_7 = ListItem(List=flatten, Index=panel_7, Wrap=True)
neg_13 = Negative(Value=subtraction_9)
boxrec_4 = BoxRectangle(Rectangle=rectangle.Rectangle, Height=dom_16)
series_3 = Series(Start=0, Step=1, Count=Slider(12, range=0..20))
division_4 = Division(B=2)
dom_18 = ConstructDomain(DomainStart=neg_13, DomainEnd=subtraction_9)
number_slider_10 = Slider(2.7, range=0..10)
panel_8 = Panel("""8
9
10
11""")
crv = Curve(rectangle_6.Rectangle)
Z_3 = UnitZ(Factor=高さ方向のオフセット)
addition_5 = Addition(A=一列の高さ, B=ミノ高さ１)
num_3 = Number(addition_5)
division_5 = Division(A=num_3, B=2)
addition_6 = Addition(A=division_3, B=division_5)
subtraction_10 = Subtraction(A=division_3, B=division_5)
pt_3 = ConstructPoint(XCoordinate=subtraction_10, YCoordinate=0, ZCoordinate=0)
pt_4 = ConstructPoint(XCoordinate=addition_6, YCoordinate=0, ZCoordinate=0)
move = Move(Geometry=pt_4, Motion=Z)  # -> Geometry, Transform
move_2 = Move(Geometry=pt_3, Motion=Z)  # -> Geometry, Transform
move_3 = Move(Geometry=pt_4, Motion=Z_2)  # -> Geometry, Transform
move_4 = Move(Geometry=pt_3, Motion=Z_2)  # -> Geometry, Transform
merge = Merge(Data1=pt, Data2=move_4.Geometry, Data3=move_2.Geometry, Data4=move.Geometry, Data5=move_3.Geometry, Data6=pt_2)
boxrec_5 = BoxRectangle(Rectangle=rectangle_5.Rectangle, Height=dom_17)
rectangle_7 = Rectangle(Plane=PlaneXY(0, 0, 0), XSize=dom_3, YSize=dom_2, Radius=0)  # -> Rectangle, Length
pline = PolyLine(Vertices=merge, Closed=True)
panel_9 = Panel("""1
3
5
7""")
rectangle_8 = Rectangle(Plane=PlaneXY(0, 0, 0), XSize=dom_18, YSize=dom_18, Radius=0)  # -> Rectangle, Length
rectangle_9 = Rectangle(Plane=PlaneXY(0, 0, 0), XSize=dom, YSize=dom, Radius=0)  # -> Rectangle, Length
division_6 = Division(A=一列の高さ, B=3)
boundary = BoundarySurfaces(Edges=crv)
boundary_2 = BoundarySurfaces(Edges=pline)
Z_4 = UnitZ(Factor=addition_5)
Y = UnitY(Factor=Slider(50, range=0..100))
scale_nu = ScaleNU(Geometry=rectangle_8.Rectangle, Plane=PlaneXY(0, 0, 0), ScaleX=number_slider_6, ScaleY=number_slider_6, ScaleZ=1)  # -> Geometry, Transform
addition_7 = Addition(A=高さ方向のオフセット, B=division_6)
Z_5 = UnitZ(Factor=ミノの頭の高さ位置)
extr = Extrude(Base=boundary_2, Direction=Y)
division_7 = Division(A=一列の高さ, B=2)
filedge = FilletEdge(Shape=boxrec_5, Blend=0, Metric=1, Edges=panel_8, Radii=number_slider_9)
filedge_2 = FilletEdge(Shape=boxrec_4, Blend=0, Metric=1, Edges=series_3, Radii=number_slider_9)
Z_6 = UnitZ(Factor=addition_7)
extr_2 = Extrude(Base=boundary, Direction=Z_4)
filedge_3 = FilletEdge(Shape=boxrec_2, Blend=0, Metric=1, Edges=panel_9, Radii=number_slider_10)
addition_8 = Addition(A=高さ方向のオフセット, B=Slider(1, range=0..1))
Z_7 = UnitZ(Factor=ミノ高さ２)
addition_9 = Addition(A=Z_3, B=Z_5)
Z_8 = UnitZ(Factor=addition)
Z_9 = UnitZ(Factor=ミノ高さ１)
brep = Brep(extr)
move_5 = Move(Geometry=filedge_2, Motion=Z_3)  # -> Geometry, Transform
move_6 = Move(Geometry=boxrec, Motion=Z_6)  # -> Geometry, Transform
Z_10 = UnitZ(Factor=addition_8)
addition_10 = Addition(A=Z_3, B=Z_8, C=Z_9, D=Z_7)
brep_2 = Brep(boxrec_3)
move_7 = Move(Geometry=filedge_3, Motion=Z_3)  # -> Geometry, Transform
move_8 = Move(Geometry=rectangle_8.Rectangle, Motion=Z_8)  # -> Geometry, Transform
move_9 = Move(Geometry=filedge, Motion=Z_10)  # -> Geometry, Transform
move_10 = Move(Geometry=scale_nu.Geometry, Motion=addition_10)  # -> Geometry, Transform
sunion = SolidUnion(Breps=[move_7.Geometry, move_6.Geometry])
move_11 = Move(Geometry=move_8.Geometry, Motion=Z_9)  # -> Geometry, Transform
boolean_difference_hispeed = BooleanDifferenceHiSpeed(x=brep_2, y=sunion)
brep_3 = Brep(boolean_difference_hispeed)
brep_4 = Brep(move_9.Geometry)
boundary_3 = BoundarySurfaces(Edges=move_8.Geometry)
loft = Loft(
    Curves=[move_8.Geometry, move_11.Geometry],
    Options={Adjust=False, Closed=False, LoftEnds=0, LoftSimp=0, LoftType=0, Rebuild=10, Refit=0.01})
loft_2 = Loft(
    Curves=[move_11.Geometry, move_10.Geometry],
    Options={Adjust=False, Closed=False, LoftEnds=0, LoftSimp=0, LoftType=0, Rebuild=10, Refit=0.01})
brep_5 = Brep(move_5.Geometry)
move_12 = Move(Geometry=brep_3, Motion=X)  # -> Geometry, Transform
move_13 = Move(Geometry=rectangle_9.Rectangle, Motion=Z_8)  # -> Geometry, Transform
move_14 = Move(Geometry=brep_3, Motion=X_2)  # -> Geometry, Transform
panel_10 = Panel("""0
-1""")
join = BrepJoin(Breps=[loft, loft_2])  # -> Breps, Closed
cull_i = CullIndex(List=move_12.Geometry, Indices=panel_10, Wrap=True)
item_8 = ListItem(List=move_12.Geometry, Index=panel_10, Wrap=True)
sunion_2 = SolidUnion(Breps=flatten(move_14.Geometry))
cap = CapHoles(Brep=join.Breps)
sunion_3 = SolidUnion(Breps=flatten(move_12.Geometry))
brep_6 = Brep(sunion_2)
sunion_4 = SolidUnion(Breps=flatten(move_12.Geometry))
volume = Volume(Geometry=brep_6)  # -> Volume, Centroid
brep_7 = Brep(cap)
merge_2 = Merge(Data1=brep_5, Data2=brep_4, Data3=brep_7)
brep_8 = Brep(sunion_3)
bbox = BoundingBox(Content=sunion_4, Plane=PlaneXY(0, 0, 0))  # -> Box, Box_2
rot3d = Rotate3D(Geometry=sunion_2, Angle=1.570796327, Center=volume.Centroid, Axis=Vector(0, 0, 1))  # -> Geometry, Transform
volume_2 = Volume(Geometry=brep_8)  # -> Volume, Centroid
scale_nu_2 = ScaleNU(Geometry=bbox.Box, Plane=volume_2.Centroid, ScaleX=Slider(0.9, range=0..1), ScaleY=1, ScaleZ=1)  # -> Geometry, Transform
rot3d_2 = Rotate3D(Geometry=sunion_3, Angle=1.570796327, Center=volume_2.Centroid, Axis=Vector(0, 0, 1))  # -> Geometry, Transform
swatch = ColourSwatch(SwatchColor=RGB(130, 255, 255))
sint = SolidIntersection(BrepsA=sunion_3, BrepsB=rot3d_2.Geometry)  # disabled
sint_2 = SolidIntersection(BrepsA=sunion_3, BrepsB=rot3d.Geometry)  # disabled
bbox_2 = BoundingBox(Content=sunion_4, Plane=PlaneXY(0, 0, 0))  # -> Box, Box_2
sunion_5 = SolidUnion(Breps=flatten(sint))
sdiff = SolidDifference(BrepsA=sunion_4, BrepsB=scale_nu_2.Geometry)
debox = DeconstructBox(Box=bbox_2.Box)  # -> Plane, X, Y, Z
sunion_6 = SolidUnion(Breps=flatten(sint_2))
division_8 = Division(A=Slider(3, range=0..5), B=2)
dedomain = DeconstructDomain(Domain=debox.X)  # -> Start, End
pt_5 = ConstructPoint(XCoordinate=0, YCoordinate=0, ZCoordinate=0)
neg_14 = Negative(Value=division_8)
sunion_7 = SolidUnion(Breps=flatten([sunion_6, sdiff, extr_2]))
sunion_8 = SolidUnion(Breps=flatten([sunion_5, sdiff, extr_2]))
subtraction_11 = Subtraction(A=dedomain.End, B=dedomain.Start)
panel_11 = Panel(subtraction_11)
dom_19 = ConstructDomain(DomainStart=neg_14, DomainEnd=division_8)
addition_11 = Addition(A=division, B=number_slider_4)
rectangle_10 = Rectangle(Plane=PlaneXY(0, 0, 0), XSize=dom_3, YSize=dom_19, Radius=0)  # -> Rectangle, Length
sunion_9 = SolidUnion(Breps=flatten(merge_2))
neg_15 = Negative(Value=division)
boxrec_6 = BoxRectangle(Rectangle=rectangle_10.Rectangle, Height=dom_11)
neg_16 = Negative(Value=addition_11)
filedge_4 = FilletEdge(Shape=boxrec_6, Blend=0, Metric=1, Edges=panel_9, Radii=number_slider_10)
dom_20 = ConstructDomain(DomainStart=neg_16, DomainEnd=neg_15)
move_15 = Move(Geometry=filedge_4, Motion=X)  # -> Geometry, Transform
panel_12 = Panel("""0
-1""")
rectangle_11 = Rectangle(Plane=PlaneXY(0, 0, 0), XSize=dom_13, YSize=dom_20, Radius=0)  # -> Rectangle, Length
Y_2 = UnitY(Factor=neg_15)
item_9 = ListItem(List=move_15.Geometry, Index=panel_12, Wrap=True)
boundary_4 = BoundarySurfaces(Edges=rectangle_11.Rectangle)
Y_3 = UnitY(Factor=Slider(-37.4, range=-50..-30))
move_16 = Move(Geometry=item_9, Motion=Y_2)  # -> Geometry, Transform
extr_3 = Extrude(Base=boundary_4, Direction=Z_4)
move_17 = Move(Geometry=move_16.Geometry, Motion=Z_3)  # -> Geometry, Transform
list = ValueList({"0", "1", "2", "3", "4", "5", "6", "7"}, selected="7")
filter = StreamFilter(
    Gate=list,
    Stream0=item,
    Stream1=item_3,
    Stream2=item_2,
    Stream3=item_4,
    Stream4=item_5,
    Stream5=item_6,
    Stream6=item_7,
    Stream7=flatten)
move2pt = MoveToPoint(Geometry=move_13.Geometry, PointA=pt_5, PointB=filter)  # -> Moved, Vector, Transform
runion = RegionUnion(Curves=move2pt.Moved)
polyoffset = PolylineOffset(
    Polylines=runion,
    Distance=ミノ同士の間隔_周りをどれぐらい削るか,
    Plane=Plane(origin=(0, 0, 0), x=(0, 0, 0), y=(0, 0, 0)),
    Tolerance=0.001,
    ClosedFillet=2,
    OpenFillet=2,
    Miter=2)  # -> Contour, Holes
crv_2 = Curve(polyoffset.Holes)
boundary_5 = BoundarySurfaces(Edges=crv_2)

crv_3 = Curve(move_8.Geometry)
crv_4 = Curve(move_11.Geometry)
crv_5 = Curve(move_10.Geometry)
crv_6 = Curve(move_11.Geometry)
number_slider_11 = Slider(4, range=0..10)
loft_3 = Loft(Curves=[crv_4, crv_3], Options={Adjust=False, Closed=False, LoftEnds=0, LoftSimp=0, LoftType=0, Rebuild=10, Refit=0.01})
loft_4 = Loft(Curves=[crv_6, crv_5], Options={Adjust=False, Closed=False, LoftEnds=0, LoftSimp=0, LoftType=0, Rebuild=10, Refit=0.01})
disc = Discontinuity(Curve=crv_4, Level=1)  # -> Points, Parameters
shatter = Shatter(Curve=crv_4, Parameters=disc.Parameters)
neg_17 = Negative(Value=Slider(2, range=0..10))
area = Area(Geometry=crv_4)  # -> Area, Centroid
cir = Circle(Plane=area.Centroid, Radius=number_slider_11)
midpt = CurveMiddle(Curve=shatter)
neg_18 = Negative(Value=Slider(2, range=0..5))
cir_2 = Circle(Plane=area.Centroid, Radius=Slider(4.2, range=0..10))
neg_19 = Negative(Value=Slider(8, range=0..10))
neg_20 = Negative(Value=Slider(6.5, range=0..10))
cap_2 = CapHoles(Brep=loft_3)
cap_3 = CapHoles(Brep=loft_4)
Z_11 = UnitZ(Factor=neg_17)
boundary_6 = BoundarySurfaces(Edges=cir)
Z_12 = UnitZ(Factor=neg_19)
vec2pt = Vector2Pt(PointA=midpt, PointB=area.Centroid, Unitize=False)  # -> Vector, Length
Z_13 = UnitZ(Factor=neg_20)
move_18 = Move(Geometry=cir, Motion=Z_11)  # -> Geometry, Transform
ext = ExtendCurve(Curve=shatter, Type=0, Start=neg_18, End=neg_18)
unit = UnitVector(Vector=vec2pt.Vector)
loft_5 = Loft(
    Curves=[cir_2, move_18.Geometry],
    Options={Adjust=False, Closed=False, LoftEnds=0, LoftSimp=0, LoftType=0, Rebuild=10, Refit=0.01})
join_2 = BrepJoin(Breps=[loft_3, loft_4])  # -> Breps, Closed
extr_4 = Extrude(Base=boundary_6, Direction=Z_12)
amp = Amplitude(Vector=unit, Amplitude=Slider(3, range=0..10))
cap_4 = CapHoles(Brep=loft_5)
cap_5 = CapHoles(Brep=loft_4)
polygon = Polygon(Plane=area.Centroid, Radius=number_slider_11, Segments=8, FilletRadius=0)  # -> Polygon, Length
move_19 = Move(Geometry=midpt, Motion=amp)  # -> Geometry, Transform
end = EndPoints(Curve=ext)  # -> Start, End
boundary_7 = BoundarySurfaces(Edges=polygon.Polygon)
extr_5 = Extrude(Base=boundary_7, Direction=Z_13)
sunion_10 = SolidUnion(Breps=flatten([cap_4, extr_4]))
arc = Arc3Pt(PointA=end.Start, PointB=move_19.Geometry, PointC=end.End)  # -> Arc, Plane, Radius
rad = Radians(Degrees=Slider(100, range=0..100))
join_3 = BrepJoin(Breps=[cap_5, extr_5])  # -> Breps, Closed
rot3d_3 = Rotate3D(Geometry=arc.Arc, Angle=rad, Center=midpt, Axis=shatter)  # -> Geometry, Transform
revsrf = Revolution(Curve=arc.Arc, Axis=shatter, Domain=Domain(0, 6.283185307))
boolean_difference_hispeed_2 = BooleanDifferenceHiSpeed(x=cap_2, y=revsrf)
brep_9 = Brep(move_5.Geometry)
brep_10 = Brep(move_9.Geometry)
sunion_11 = SolidUnion(Breps=flatten([boolean_difference_hispeed_2, brep_9, brep_10]))
Z_14 = UnitZ(Factor=Slider(1.5, range=0..5))
sunion_12 = SolidUnion(Breps=join_3.Breps)
brep_11 = Brep(sunion_11)
extr_6 = Extrude(Base=boundary_5, Direction=Z_14)
brep_12 = Brep(sunion_12)
boolean_difference_hispeed_3 = BooleanDifferenceHiSpeed(x=brep_11, y=sunion_10)
move2pt_2 = MoveToPoint(Geometry=brep_11, PointA=pt_5, PointB=filter)  # -> Moved, Vector, Transform
move2pt_3 = MoveToPoint(Geometry=sunion_10, PointA=pt_5, PointB=filter)  # -> Moved, Vector, Transform
move2pt_4 = MoveToPoint(Geometry=brep_12, PointA=pt_5, PointB=filter)  # -> Moved, Vector, Transform
sunion_13 = SolidUnion(Breps=flatten([move2pt_2.Moved, extr_6]))
boolean_difference_hispeed_4 = BooleanDifferenceHiSpeed(x=sunion_13, y=move2pt_3.Moved)

move2pt_5 = MoveToPoint(Geometry=sunion_9, PointA=pt_5, PointB=filter)  # -> Moved, Vector, Transform
extr_7 = Extrude(Base=boundary_5, Direction=Z_9)
sunion_14 = SolidUnion(Breps=flatten([move2pt_5.Moved, extr_7]))
move_20 = Move(Geometry=sunion_14, Motion=Y_3)  # -> Geometry, Transform
preview = CustomPreview(
    Geometry=move_20.Geometry,
    Material={diffuse=RGB(221, 160, 221), emission=RGB(66, 48, 66), shine=0.5, specular=RGB(255, 255, 255), transparency=0})
preview_2 = CustomPreview(Geometry=sunion_4, Material=swatch)
sunion_15 = SolidUnion(Breps=flatten([move_17.Geometry, extr_3]))
preview_3 = CustomPreview(Geometry=sunion_15, Material=swatch)

# ==== cluster BooleanDifferenceHiSpeed
x = ClusterInput()
y = ClusterInput()
boolean_difference = GhPythonScript(x=x, y=flatten(y))  # -> out, a; inputs y: list
# ---------- boolean_difference: Python ----------
import rhinoscriptsyntax as rs
a=rs.BooleanDifference(x,y)
# ---------- end boolean_difference ----------
output = ClusterOutput(boolean_difference.a)
